# Grasshopper definition rhinoPreview.gh (Grasshopper 0.9.75)
# plug-ins: Python Interpreter

panel = Panel("C:\Users\Matthias\workspace\venice\coreFunctionality\eStats.csv")
panel_2 = Panel("C:\Users\Matthias\workspace\venice\coreFunctionality\targets.csv")
panel_3 = Panel("C:\Users\Matthias\workspace\venice\coreFunctionality\eBulbs.csv")
timer = Timer(TimerInterval=50, Target=[python, python_3, python_2])

# ----
# variables
masterrange = Panel("3.5")
axescount = Panel("4")
emittercount = Panel("""12
12
12
12""")
axesspacing = Panel("1828.8")
emitterwidth = Panel("234.95")
axesheight = Panel("3500")
emittermaxpan = Panel("3500")
emittermaxpan_2 = Number(emittermaxpan)
emitterwidth_2 = Number(emitterwidth)
emittercount_2 = Number(emittercount)
masterrange_2 = Number(masterrange)
axesspacing_2 = Number(axesspacing)
axesheight_2 = Number(axesheight)
axescount_2 = Number(axescount)

python = PythonScript(x=panel)  # -> out, a
# ---------- python: Python ----------
import rhinoscriptsyntax as rs

import Rhino.Geometry as rg
from clr import AddReference as addr
addr("Grasshopper")

from System import Object
from Grasshopper import DataTree
from Grasshopper.Kernel.Data import GH_Path


def raggedListToDataTree(raggedList):
    rl = raggedList
    result = DataTree[object]()
    for i in range(len(rl)):
        temp = []
        for j in range(len(rl[i])):
            temp.append(rl[i][j])
        #print i, " - ",temp
        path = GH_Path(i)
        result.AddRange(temp, path)
    return result


try:
    csvFile = open(x, 'r')
except:
    print "error"
else:
    lineList = csvFile.read().splitlines()

    itemList = [x.split(',') for x in lineList]

    a = raggedListToDataTree(itemList)
# ---------- end python ----------
python_2 = PythonScript(x=panel_3)  # -> out, a
# ---------- python_2: Python ----------
import rhinoscriptsyntax as rs

import Rhino.Geometry as rg
from clr import AddReference as addr
addr("Grasshopper")

from System import Object
from Grasshopper import DataTree
from Grasshopper.Kernel.Data import GH_Path


def raggedListToDataTree(raggedList):
    rl = raggedList
    result = DataTree[object]()
    for i in range(len(rl)):
        temp = []
        for j in range(len(rl[i])):
            temp.append(int(rl[i][j]))
        #print i, " - ",temp
        path = GH_Path(i)
        result.AddRange(temp, path)
    return result


try:
    csvFile = open(x, 'r')
except:
    print "error"
else:
    lineList = csvFile.read().splitlines()

    itemList = [x.split(',') for x in lineList]
    print itemList
    a = raggedListToDataTree(itemList)
# ---------- end python_2 ----------
python_3 = PythonScript(x=panel_2)  # -> out, a
# ---------- python_3: Python ----------
import rhinoscriptsyntax as rs

import Rhino.Geometry as rg
from clr import AddReference as addr
addr("Grasshopper")

from System import Object
from Grasshopper import DataTree
from Grasshopper.Kernel.Data import GH_Path


def raggedListToDataTree(raggedList):
    rl = raggedList
    result = DataTree[object]()
    for i in range(len(rl)):
        temp = []
        for j in range(len(rl[i])):
            temp.append(rl[i][j])
        #print i, " - ",temp
        path = GH_Path(i)
        result.AddRange(temp, path)
    return result


try:
    csvFile = open(x, 'r')
except:
    print "error"
else:
    lineList = csvFile.read().splitlines()

    itemList = [x.split(',') for x in lineList]
    
    pointList = []
    for point in itemList:
        string = "(" + str(point[0]) + "," + str(point[1]) + "," +  str(point[2]) + ")"
        #pointList.append(string)
        pointList.append(rs.AddPoint(point))
    print pointList
    a = DataTree[Object]()
    a.AddRange(pointList)
# ---------- end python_3 ----------
panel_4 = Panel(python_2.out)
panel_5 = Panel(python_3.out)
larger = LargerThan(FirstNumber=python_2.a, SecondNumber="2")  # -> LargerThan, OrEqualTo
panel_6 = Panel(python.out)
panel_7 = Panel(python_2.a)
rec = DataRecorder(python_3.a, DataLimit=2, RecordData=True)
pt = Point(rec)
pdecon = Deconstruct(Point=pt)  # -> XComponent, YComponent, ZComponent
pt_2 = ConstructPoint(XCoordinate=pdecon.XComponent, YCoordinate=pdecon.YComponent, ZCoordinate=0)
xy = XYPlane(Origin=pt_2)
panel_8 = Panel(rec)
cyl = Cylinder(Base=xy, Radius=150, Length=1700)
panel_9 = Panel(python.a)
subtraction = Subtraction(A=panel_9, B=90)
red = Colour(RGB(255, 0, 0))
black = Colour(RGB(0, 0, 0))

# ----
# preview
emitterwidth_3 = Number(emitterwidth_2)
emittercount_3 = Number(emittercount_2)
axesspacing_3 = Number(axesspacing_2)
anglesindeg = Number(subtraction)
axesheight_3 = Number(axesheight_2)
axescount_3 = Number(axescount_2)
Y = UnitY(Factor=1)
neg = Negative(Value=emitterwidth_3)
Z = UnitZ(Factor=neg)
division = Division(A=emitterwidth_3, B="2")
neg_2 = Negative(Value=division)
multiplication = Multiplication(A=Z, B="10")
dom = ConstructDomain(DomainStart=neg_2, DomainEnd=division)

neg_3 = Negative(Value=anglesindeg)

# ----
# emitter centers
panel_10 = Panel("0")
series = Series(Start=panel_10, Step=axesspacing_3, Count=axescount_3)  # -> graft(Series)
series_2 = Series(Start="1645", Step=emitterwidth_3, Count=emittercount_3)
pt_3 = ConstructPoint(XCoordinate=series, YCoordinate=series_2, ZCoordinate=axesheight_3)

rad = Radians(Degrees=neg_3)
addition = Addition(A=pt_3, B=Z)
xy_2 = XYPlane(Origin=addition)
addition_2 = Addition(A=pt_3, B=multiplication)
rectangle = Rectangle(Plane=xy_2, XSize=dom, YSize=dom, Radius=0)  # -> Rectangle, Length
ln = Line(StartPoint=pt_3, EndPoint=addition_2)
rot3d = Rotate3D(Geometry=rectangle.Rectangle, Angle=rad, Center=pt_3, Axis=Y)  # -> Geometry, Transform
rot3d_2 = Rotate3D(Geometry=ln, Angle=rad, Center=pt_3, Axis=Y)  # -> Geometry, Transform
emitterrectangles = Geometry(rot3d.Geometry)
emitterrays = Geometry(rot3d_2.Geometry)

dispatch = Dispatch(List=emitterrectangles, DispatchPattern=larger.OrEqualTo)  # -> ListA, ListB
dispatch_2 = Dispatch(List=emitterrays, DispatchPattern=larger.OrEqualTo)  # -> ListA, ListB
preview = CustomPreview(Geometry=[dispatch_2.ListA, dispatch.ListA], Shader=red)
preview_2 = CustomPreview(Geometry=[dispatch.ListB, dispatch_2.ListB], Shader=black)
